# Grasshopper definition dendrite_growth_spheres.gh (Grasshopper 1.0.8)

# ---- group: Auto-reloads cdf module on VScode changes
path = FilePath()
autoreloader = Python3Script(src_path=path)  # -> out; inputs src_path: String
# ---------- autoreloader: Python ----------
#! python3
import sys, os, time
import scriptcontext as sc
import Rhino, System
from System.IO import FileSystemWatcher, NotifyFilters

VERSION = 1  
pkg = "cdf"

if not src_path:
    raise Exception("Connect a folder to src_path.")
path = os.path.normpath(src_path)
watch_dir = os.path.join(path, pkg)
if not os.path.isdir(watch_dir):
    raise Exception("No '{}' folder found in:\n{}".format(pkg, path))

def unload():
    for name in list(sys.modules):
        if name == pkg or name.startswith(pkg + "."):
            del sys.modules[name]

# Put this folder first in Python's search list
if path in sys.path:
    sys.path.remove(path)
sys.path.insert(0, path)

key = "cdf_watcher_" + str(ghenv.Component.InstanceGuid)
time_key = key + "_time"
version_key = key + "_version"

def stamp():
    sc.sticky[time_key] = time.strftime("%Y-%m-%d %H:%M:%S")

# Replace the old watcher if the folder changed or the script was updated
old = sc.sticky.get(key)
if old is not None and (os.path.normpath(old.Path) != watch_dir
                        or sc.sticky.get(version_key) != VERSION):
    old.Dispose()
    del sc.sticky[key]
    unload()

if key not in sc.sticky:
    comp = ghenv.Component
    last = [0.0]

    def reload_and_rerun():
        unload()
        stamp()
        doc = comp.OnPingDocument()
        if doc is None:            # reloader was deleted or the file closed
            return
        for obj in doc.Objects:
            if "Python" in obj.GetType().Name:
                obj.ExpireSolution(False)   # mark as out of date
        doc.NewSolution(False)              # recompute once

    def on_change(sender, e):
        if not e.FullPath.endswith(".py") or "__pycache__" in e.FullPath:
            return
        if time.time() - last[0] < 0.5:     # ignore the second event of a double save
            return
        last[0] = time.time()
        Rhino.RhinoApp.InvokeOnUiThread(System.Action(reload_and_rerun))

    w = FileSystemWatcher(watch_dir, "*.py")
    w.IncludeSubdirectories = True
    w.NotifyFilter = NotifyFilters.LastWrite
    w.Changed += on_change
    w.EnableRaisingEvents = True
    sc.sticky[key] = w
    sc.sticky[version_key] = VERSION
    stamp()                                  # time the watcher started

msg = "Last reloaded: {}\nWatching: {}".format(sc.sticky.get(time_key, "unknown"), watch_dir)
print(msg)
out = msg
# ---------- end autoreloader ----------
panel = Panel(autoreloader)

# ----
pt = Point(Point(0, 0, 0))
vec = Vector(Vector(-3.152277059, -1.305000319, 0))
dendrite_growth = Python3Script(
    seed_pt=pt,
    seed_radius=Slider(6.6, range=0..10),
    iterations=Slider(11, range=1..20),
    step_factor=Slider(5.7, range=0..10),
    radius_decay=Slider(0.92, range=0..1),
    branch_chance=Slider(0.63, range=0..1),
    angle_max=Slider(0.9, range=0..1000),
    min_radius=Slider(0.05, range=0..0.1),
    collide_scale=Slider(1.02, range=0..10),
    seed_dir=vec)  # -> out, tips_pts, spheres, lines; inputs seed_pt: Point3d, seed_radius: Double, iterations: Int32, step_factor: Double, branch_chance: Double, angle_max: Double, min_radius: Double, collide_scale: Double
# ---------- dendrite_growth: Python ----------
"""
INPUT PARAMETERS (Grasshopper inputs)

seed_pt       : Point3d  (start point)
seed_radius   : float    (radius of first sphere)
iterations    : int      (max generations)
radius_decay  : float    (shrink factor per generation)
branch_chance : float    (chance of a second child)
angle_max     : float    (max deflection angle in radians)
min_radius    : float    (stop when spheres get too small)
seed_dir      : Vector3d or None (optional initial direction)
"""

from cdf import grow_tangent_spheres

spheres, lines, tips_pts = grow_tangent_spheres(
    seed_pt=seed_pt,
    seed_radius=seed_radius,
    iterations=iterations,
    radius_decay=radius_decay,
    branch_chance=branch_chance,
    angle_max=angle_max,
    min_radius=min_radius,
    seed_dir=seed_dir,
)
# ---------- end dendrite_growth ----------
pt_2 = Point(dendrite_growth.tips_pts)
geo = Geometry(dendrite_growth.spheres)
line = Line(dendrite_growth.lines)
preview = CustomPreview(Geometry=geo, Material=ColourSwatch(SwatchColor=RGB(255, 205, 205)))
