# Grasshopper definition recursive_growth.gh (Grasshopper 1.0.8)

# ----
# Recursive Growth
number_slider = Slider(2, range=1..4)
pt = Point(Point(6.186889619, -0.05857602619, 0))
pln = Plane(PlaneXY(5.320675441, 2.093898757, 0))
line_fractal_tree = Python3Script(
    base_point=pt,
    base_plane=pln,
    length=Slider(13.4, range=0..100),
    angle=Slider(74, range=0..100),
    length_factor=Slider(0.6, range=0..1),
    depth=Slider(8, range=0..10),
    branch_count=number_slider)  # -> out, lines; inputs base_point: Point3d
# ---------- line_fractal_tree: Python ----------
"""GHPython 3 component -- Fractal Tree"""
from cdf import create_fractal_tree

lines = create_fractal_tree(
    base_point=base_point, # Point3d input, defaults to origin if None
    base_plane=base_plane, # Plane input, defaults to WorldXY if None
    length=length, # float input, e.g. 10.0
    angle=angle, # float input, e.g. 25.0 (degrees)
    length_factor=length_factor, # float input, e.g. 0.7
    depth=int(depth), # int input, e.g. 8
    branch_count=int(branch_count), # int input, e.g. 2
    )
# ---------- end line_fractal_tree ----------

# ---- group: counter
# Plug a list of objects to the "list" and visualize in an animation.
start = Button()
stop = Button()
step = Button()
back = Button()
reset = Button()
full = Button()
list = ValueList({"20", "50", "100", "500", "1000", "5000"}, selected="50")
list_2 = Data(line_fractal_tree.lines)
counter = Python3Script(L=list_2, start=start, stop=stop, step=step, step_back=back, reset=reset, full=full, interval=list)  # -> out, counter; inputs L: list
# ---------- counter: Python ----------
from scriptcontext import sticky as st
import Grasshopper

def update_component(ghenv, delay):
    """Schedule an update of the Grasshopper component.

    After the specified delay, the GH component will be automatically updated.

    Parameters
    ----------
    ghenv : :class:`GhPython.Component.PythonEnvironment`
        The current GHPython environment.
    delay : :obj:`int`
        Time in milliseconds until the update is performed.

    Raises
    ------
    ValueError
        If the delay is less than zero.

    """
    if delay <= 0:
        raise ValueError("Delay must be greater than zero")

    ghcomp = ghenv.Component
    ghdoc = ghcomp.OnPingDocument()

    def callback(ghdoc):
        if ghdoc.SolutionState != Grasshopper.Kernel.GH_ProcessStep.Process:
            ghcomp.ExpireSolution(False)

    ghdoc.ScheduleSolution(delay, Grasshopper.Kernel.GH_Document.GH_ScheduleDelegate(callback))


# store data in component
guid = str(ghenv.Component.InstanceGuid)
counter_key = "counter_" + guid
running_key = "running_" + guid

if counter_key not in st:
    st[counter_key] = 0

if running_key not in st:
    st[running_key] = False
    

if st[running_key]:
    if st[counter_key] < len(L) - 1:
        st[counter_key] += 1
        update_component(ghenv, interval)
    else:
        st[counter_key] = 0
        st[running_key] = False
    
if start:
    st[running_key] = True

if stop:
    st[running_key] = False

if step:
    if st[counter_key] < len(L) - 1:
        st[counter_key] += 1

if step_back:
    if st[counter_key] > 0:
        st[counter_key] -= 1

if reset:
    st[counter_key] = 0
    st[running_key] = False

if full:
    st[counter_key] = len(L)-1

if len(L):
    item = L[st[counter_key]]

counter = st[counter_key]
# ---------- end counter ----------
panel = Panel(counter.counter)

# ---- group: Auto-reloads cdf module on VScode changes
# Setting path for Src AutoReloader: 1. Right click on Path
# 2. Choose "Select a directory"
# 3. Locate the ..\cdf1_teaching\src folder in your computer
path = FilePath()
autoreloader = Python3Script(src_path=path)  # -> out; inputs src_path: String
# ---------- autoreloader: Python ----------
#! python3
import sys, os, time
import scriptcontext as sc
import Rhino, System
from System.IO import FileSystemWatcher, NotifyFilters

VERSION = 1  
pkg = "cdf"

if not src_path:
    raise Exception("Connect a folder to src_path.")
path = os.path.normpath(src_path)
watch_dir = os.path.join(path, pkg)
if not os.path.isdir(watch_dir):
    raise Exception("No '{}' folder found in:\n{}".format(pkg, path))

def unload():
    for name in list(sys.modules):
        if name == pkg or name.startswith(pkg + "."):
            del sys.modules[name]

# Put this folder first in Python's search list
if path in sys.path:
    sys.path.remove(path)
sys.path.insert(0, path)

key = "cdf_watcher_" + str(ghenv.Component.InstanceGuid)
time_key = key + "_time"
version_key = key + "_version"

def stamp():
    sc.sticky[time_key] = time.strftime("%Y-%m-%d %H:%M:%S")

# Replace the old watcher if the folder changed or the script was updated
old = sc.sticky.get(key)
if old is not None and (os.path.normpath(old.Path) != watch_dir
                        or sc.sticky.get(version_key) != VERSION):
    old.Dispose()
    del sc.sticky[key]
    unload()

if key not in sc.sticky:
    comp = ghenv.Component
    last = [0.0]

    def reload_and_rerun():
        unload()
        stamp()
        doc = comp.OnPingDocument()
        if doc is None:            # reloader was deleted or the file closed
            return
        for obj in doc.Objects:
            if "Python" in obj.GetType().Name:
                obj.ExpireSolution(False)   # mark as out of date
        doc.NewSolution(False)              # recompute once

    def on_change(sender, e):
        if not e.FullPath.endswith(".py") or "__pycache__" in e.FullPath:
            return
        if time.time() - last[0] < 0.5:     # ignore the second event of a double save
            return
        last[0] = time.time()
        Rhino.RhinoApp.InvokeOnUiThread(System.Action(reload_and_rerun))

    w = FileSystemWatcher(watch_dir, "*.py")
    w.IncludeSubdirectories = True
    w.NotifyFilter = NotifyFilters.LastWrite
    w.Changed += on_change
    w.EnableRaisingEvents = True
    sc.sticky[key] = w
    sc.sticky[version_key] = VERSION
    stamp()                                  # time the watcher started

msg = "Last reloaded: {}\nWatching: {}".format(sc.sticky.get(time_key, "unknown"), watch_dir)
print(msg)
out = msg
# ---------- end autoreloader ----------
panel_2 = Panel(autoreloader)

# ---- group: Visualize
select = Python3Script(object_list=list_2, counter=counter.counter)  # -> current, previous; inputs object_list: list
# ---------- select: Python ----------
current = object_list[counter]
previous = object_list[:counter]
# ---------- end select ----------
preview = CustomPreview(Geometry=select.current, Material=ColourSwatch(SwatchColor=RGB(60, 230, 88)))
preview_2 = CustomPreview(Geometry=select.previous, Material=ColourSwatch(SwatchColor=RGB(255, 86, 88)))
