# Grasshopper definition geometry_basics.ghx (Grasshopper 1.0.8)

# ---- group: Example: Build a Parametric Cone
pt = Point(Point(-0.4439523925, 0.05137995213, 0))
cone = Python3Script(pt=pt, h=Slider(1, range=1..10), r=Slider(1, range=1..10))  # -> out, my_cone; inputs pt: Point3d
# ---------- cone: Python ----------
# import function
from computational_design_and_fabrication import create_cone

# call function
my_cone = create_cone(base_point=pt, height=h, radius=r)
# ---------- end cone ----------

# ---- group: Reload after Updating Code
# Notes for teaching
# - show input and output
# - show value types: bool, int etc. and how to set value type in python block
# - show how to read errors, they are readible.
# -preview/not ->visualise
# 
# https://developer.rhino3d.com/guides/scripting/scripting-component/#script-inputs-and-outputs
button = Button()
reload = Python3Script(reload=button)  # -> out
# ---------- reload: Python ----------
if reload:
    from compas_rhino import unload_modules
    unload_modules("assembly_information_model")
    unload_modules('mobile_robot_control')
    unload_modules('fabrication_manager')
    unload_modules('ur_fabrication_control')
    unload_modules('spaicr')
    unload_modules('workshop_robarch_2026')
# ---------- end reload ----------

# ----
# seperate to algorithms: bring as outlook
pt_2 = Point(Point(6.186889619, -0.05857602619, 0))
pln = Plane(PlaneXY(5.320675441, 2.093898757, 0))
py3 = Python3Script(
    base_point=pt_2,
    base_plane=pln,
    length=Slider(13.4, range=0..100),
    angle=Slider(74, range=0..100),
    length_factor=Slider(0.6, range=0..1),
    depth=Slider(8, range=0..10),
    branch_count=Slider(2, range=1..4))  # -> out, lines; inputs base_point: Point3d
# ---------- py3: Python ----------
"""GHPython 3 component -- Fractal Tree"""
from computational_design_and_fabrication import create_fractal_tree

lines = create_fractal_tree(
    base_point=base_point, # Point3d input, defaults to origin if None
    base_plane=base_plane, # Plane input, defaults to WorldXY if None
    length=length, # float input, e.g. 10.0
    angle=angle, # float input, e.g. 25.0 (degrees)
    length_factor=length_factor, # float input, e.g. 0.7
    depth=int(depth), # int input, e.g. 8
    branch_count=int(branch_count), # int input, e.g. 2
    )
# ---------- end py3 ----------

# ---- group: counter
# Plug a list of objects to the "list" and visualize single item from the list as the "item".
start = Button()
stop = Button()
step = Button()
back = Button()
reset = Button()
full = Button()
list = ValueList({"20", "50", "100", "500", "1000", "5000"}, selected="50")
list_2 = Data(py3.lines)
counter = Python3Script(L=list_2, start=start, stop=stop, step=step, step_back=back, reset=reset, full=full, interval=list)  # -> out, counter; inputs L: list
# ---------- counter: Python ----------
from scriptcontext import sticky as st
import Grasshopper

def update_component(ghenv, delay):
    """Schedule an update of the Grasshopper component.

    After the specified delay, the GH component will be automatically updated.

    Parameters
    ----------
    ghenv : :class:`GhPython.Component.PythonEnvironment`
        The current GHPython environment.
    delay : :obj:`int`
        Time in milliseconds until the update is performed.

    Raises
    ------
    ValueError
        If the delay is less than zero.

    """
    if delay <= 0:
        raise ValueError("Delay must be greater than zero")

    ghcomp = ghenv.Component
    ghdoc = ghcomp.OnPingDocument()

    def callback(ghdoc):
        if ghdoc.SolutionState != Grasshopper.Kernel.GH_ProcessStep.Process:
            ghcomp.ExpireSolution(False)

    ghdoc.ScheduleSolution(delay, Grasshopper.Kernel.GH_Document.GH_ScheduleDelegate(callback))


# store data in component
guid = str(ghenv.Component.InstanceGuid)
counter_key = "counter_" + guid
running_key = "running_" + guid

if counter_key not in st:
    st[counter_key] = 0

if running_key not in st:
    st[running_key] = False
    

if st[running_key]:
    if st[counter_key] < len(L) - 1:
        st[counter_key] += 1
        update_component(ghenv, interval)
    else:
        st[counter_key] = 0
        st[running_key] = False
    
if start:
    st[running_key] = True

if stop:
    st[running_key] = False

if step:
    if st[counter_key] < len(L) - 1:
        st[counter_key] += 1

if step_back:
    if st[counter_key] > 0:
        st[counter_key] -= 1

if reset:
    st[counter_key] = 0
    st[running_key] = False

if full:
    st[counter_key] = len(L)-1

if len(L):
    item = L[st[counter_key]]

counter = st[counter_key]
# ---------- end counter ----------
# add a branch so it grows
item = ListItem(List=list_2, Index=counter.counter, Wrap=True)
panel = Panel(counter.counter)
item_2 = Data(item)

# ---- group: TODO: Build a Parametric Sphere
sphere = Python3Script()  # -> out, a

# ---- group: TODO: Make a Boolean Difference
boolean = Python3Script(my_cone=cone.my_cone, my_sphere=sphere.a)  # -> out, result_geometry; unedited script template

# ---- group: Visualize
preview = CustomPreview(Geometry=cone.my_cone, Material=ColourSwatch(SwatchColor=RGB(60, 230, 88)))

preview_2 = CustomPreview(Geometry=sphere.a, Material=ColourSwatch(SwatchColor=RGB(255, 86, 88)))
