# Grasshopper definition differential_growth.gh (Grasshopper 1.0.8)

# ---- group: Reload after Updating Code
reload = Python3Script(reload=Button())  # -> out
# ---------- reload: Python ----------
if reload:
    from compas_rhino import unload_modules
    unload_modules("cdf")
# ---------- end reload ----------

# ----
# Differential Growth
number_slider = Slider(1.9, range=0..3)
show = BooleanToggle(True)
pseudosphere = Python3Script(
    show=show,
    rounds=Slider(5, range=1..10),
    increase=Slider(2, range=1..3),
    base_chain=Slider(4, range=1..10),
    first_round=Slider(12, range=1..20),
    stitch_width=Slider(1, range=0..3),
    stitch_height=number_slider)  # -> out, my_pseudosphere; inputs rounds: Int32, increase: Int32, first_round: Int32
# ---------- pseudosphere: Python ----------
from cdf import create_crochet_pseudosphere

if show:
    my_pseudosphere = create_crochet_pseudosphere(rounds=rounds,
                                                    first_round=first_round,
                                                    increase=increase,
                                                    base_chain=base_chain,
                                                    stitch_width=stitch_width,
                                                    stitch_height=stitch_height)
# ---------- end pseudosphere ----------
preview = CustomPreview(Geometry=pseudosphere.my_pseudosphere, Material=ColourSwatch(SwatchColor=RGBA(189, 104, 171, 154)))
