# Grasshopper definition rule-based-algorithms.gh (Grasshopper 1.0.8)

# ----
# Recursive Growth
number_slider = Slider(2, range=1..4)
pt = Point(Point(6.186889619, -0.05857602619, 0))
pln = Plane(PlaneXY(5.320675441, 2.093898757, 0))
line_fractal_tree = Python3Script(
    base_point=pt,
    base_plane=pln,
    length=Slider(13.4, range=0..100),
    angle=Slider(74, range=0..100),
    length_factor=Slider(0.6, range=0..1),
    depth=Slider(8, range=0..10),
    branch_count=number_slider)  # -> out, lines; inputs base_point: Point3d
# ---------- line_fractal_tree: Python ----------
"""GHPython 3 component -- Fractal Tree"""
from cdf import create_fractal_tree

lines = create_fractal_tree(
    base_point=base_point, # Point3d input, defaults to origin if None
    base_plane=base_plane, # Plane input, defaults to WorldXY if None
    length=length, # float input, e.g. 10.0
    angle=angle, # float input, e.g. 25.0 (degrees)
    length_factor=length_factor, # float input, e.g. 0.7
    depth=int(depth), # int input, e.g. 8
    branch_count=int(branch_count), # int input, e.g. 2
    )
# ---------- end line_fractal_tree ----------

# ---- group: counter
# Plug a list of objects to the "list" and visualize in an animation.
start = Button()
stop = Button()
step = Button()
back = Button()
reset = Button()
full = Button()
list = ValueList({"20", "50", "100", "500", "1000", "5000"}, selected="50")
list_2 = Data(line_fractal_tree.lines)
counter = Python3Script(L=list_2, start=start, stop=stop, step=step, step_back=back, reset=reset, full=full, interval=list)  # -> out, counter; inputs L: list
# ---------- counter: Python ----------
from scriptcontext import sticky as st
import Grasshopper

def update_component(ghenv, delay):
    """Schedule an update of the Grasshopper component.

    After the specified delay, the GH component will be automatically updated.

    Parameters
    ----------
    ghenv : :class:`GhPython.Component.PythonEnvironment`
        The current GHPython environment.
    delay : :obj:`int`
        Time in milliseconds until the update is performed.

    Raises
    ------
    ValueError
        If the delay is less than zero.

    """
    if delay <= 0:
        raise ValueError("Delay must be greater than zero")

    ghcomp = ghenv.Component
    ghdoc = ghcomp.OnPingDocument()

    def callback(ghdoc):
        if ghdoc.SolutionState != Grasshopper.Kernel.GH_ProcessStep.Process:
            ghcomp.ExpireSolution(False)

    ghdoc.ScheduleSolution(delay, Grasshopper.Kernel.GH_Document.GH_ScheduleDelegate(callback))


# store data in component
guid = str(ghenv.Component.InstanceGuid)
counter_key = "counter_" + guid
running_key = "running_" + guid

if counter_key not in st:
    st[counter_key] = 0

if running_key not in st:
    st[running_key] = False
    

if st[running_key]:
    if st[counter_key] < len(L) - 1:
        st[counter_key] += 1
        update_component(ghenv, interval)
    else:
        st[counter_key] = 0
        st[running_key] = False
    
if start:
    st[running_key] = True

if stop:
    st[running_key] = False

if step:
    if st[counter_key] < len(L) - 1:
        st[counter_key] += 1

if step_back:
    if st[counter_key] > 0:
        st[counter_key] -= 1

if reset:
    st[counter_key] = 0
    st[running_key] = False

if full:
    st[counter_key] = len(L)-1

if len(L):
    item = L[st[counter_key]]

counter = st[counter_key]
# ---------- end counter ----------
panel = Panel(counter.counter)

# ---- group: Reload after Updating Code
reload = Python3Script(reload=Button())  # -> out
# ---------- reload: Python ----------
if reload:
    from compas_rhino import unload_modules
    unload_modules("cdf")
# ---------- end reload ----------

# ----
# Differential Growth
number_slider_2 = Slider(1.9, range=0..3)
show = BooleanToggle(False)
pseudosphere = Python3Script(
    show=show,
    rounds=Slider(4, range=1..10),
    increase=Slider(2, range=1..3),
    base_chain=Slider(4, range=1..10),
    first_round=Slider(12, range=1..20),
    stitch_width=Slider(1, range=0..3),
    stitch_height=number_slider_2)  # -> out, my_pseudosphere; inputs rounds: Int32, increase: Int32, first_round: Int32
# ---------- pseudosphere: Python ----------
from cdf import create_crochet_pseudosphere

if show:
    my_pseudosphere = create_crochet_pseudosphere(rounds=rounds,
                                                    first_round=first_round,
                                                    increase=increase,
                                                    base_chain=base_chain,
                                                    stitch_width=stitch_width,
                                                    stitch_height=stitch_height)
# ---------- end pseudosphere ----------
preview = CustomPreview(Geometry=pseudosphere.my_pseudosphere, Material=ColourSwatch(SwatchColor=RGBA(189, 104, 171, 154)))

# ---- group: Visualize
select = Python3Script(object_list=list_2, counter=counter.counter)  # -> current, previous; inputs object_list: list
# ---------- select: Python ----------
current = object_list[counter]
previous = object_list[:counter]
# ---------- end select ----------
preview_2 = CustomPreview(Geometry=select.current, Material=ColourSwatch(SwatchColor=RGB(60, 230, 88)))
preview_3 = CustomPreview(Geometry=select.previous, Material=ColourSwatch(SwatchColor=RGB(255, 86, 88)))
