# Grasshopper definition design_tool_slicing.gh (Grasshopper 1.0.8)
# plug-ins: RhinoCodePluginGH, CEM_Calculate_Structure, CEM_Extract_Structure, Pufferfish, CEM_Extract_Topology, CEM_Constraint_Plane, CEM_Build_Topology

# ----
# General Parameters
# Number of Legs
# Number of Segments
# Vertical Offset of Tension Ring
# Height
# Scaling Opening
n_radial = Slider(5, range=2..10)
n_tangential = Slider(7, range=2..10)
vertical_offset_tension_hoop = Slider(1.2, range=-2..2)
height = Slider(4, range=0..10)
scaling_factor = Slider(1.31, range=0.3..3)

# ----
# CEM - Topology Set-Up
cluster = Cluster(N=n_radial, relay=n_tangential, F=vertical_offset_tension_hoop)  # -> pt_2, P_3, L, P_4, L_2, P_5, P, P_2, A
radial_deviations = Line(cluster.L_2)
radial_deviations_2 = Line(cluster.P_2)
support_nodes = Point(cluster.P_5)
support_nodes_2 = Point(cluster.P_4)
# FormFinding
origin_nodes = Point(cluster.P_3)
trails = Line(cluster.L)
trails_2 = Line(cluster.P)
line = Line(cluster.A)

# ----
# CEM - Constraint Planes
# Two Lines determine the inclination of the Constraints Planes;
# By varying their length, the inclination and therefore the segment length is modified.
# Line Length - Outside L1
# Line Length - Center L2
number_slider = Slider(3.4, range=0..5)

# ----
# Pretension
# You can activate a possible exterior pretension of the structure. Choose 'Tension' for activating or 'Null' for deactivating.
# The Numbers are defining the acting inner forces in the pretension system.
list = ValueList({"Tension": 1, "Null": 0}, selected="Tension")

# ----
# Roof Elements
# You can prescribe if the radial roof elements are acting in tension or compression and assign a uniform order of magnitude for all elements. Those parameters, in comparison to the applied roof loading, are responsible for the resulting inclination of the leg elements.
list_2 = ValueList({"Tension": 1, "Compression": -1}, selected="Compression")

# ----
# CEM - Updated Loading
# Once the first geometry is materialized, update the dead weight by pressing the play bottom.
# Point Loads - Roof
# Point Loads - Legs
input = DataInput(
    Destination="C:\Users\Ema Krakovska\Downloads\250107_Roof_Load.ghdata",
    RelativePath="C:\Users\Ema Krakovska\Downloads\250107_Roof_Load.ghdata|..\..\..\Downloads\250107_Roof_Load.ghdata",
    UpdateDelay=50000)
input_2 = DataInput(
    Destination="C:\Users\Ema Krakovska\Downloads\250107_Legs_Load.ghdata",
    RelativePath="C:\Users\Ema Krakovska\Downloads\250107_Legs_Load.ghdata|..\..\..\Downloads\250107_Legs_Load.ghdata",
    UpdateDelay=50000)
panel = Panel(input_2)
dam = DataDam(DataA=panel, BufferDelay=10000000, BufferMode=0)
dam_2 = DataDam(DataA=input, BufferDelay=10000000, BufferMode=0)

# ----
# Slicing
# This part of the tool takes in the geometry of the components from the materialization part and slices them to create a toolpath for the robot for each layer.
# Particle bed
# Set the size of the particle bed
width = Slider(1.45, range=0..2)
length = Slider(1.55, range=0..2)
particle_bed = ParticleBed(A_2=width, A=length, H=Slider(1.07, range=0..1.2))  # -> cv, B
preview = CustomPreview(Geometry=particle_bed.B, Material=ColourSwatch(SwatchColor=RGBA(159, 139, 224, 26)))

# ----
# Leg parameters
# Adjust k1 parameter for the top and the bottom section of the legs. The middle sections are derived from the top and bottom section and interpolated by a third point, controlled by middle_x and middle_z.
middle_x = Slider(0.3, range=-0.6..0.6)
middle_z = Slider(0.73, range=-1..1)

# ----
# Ring parameters
# Adjust the parametrs to control the ring.
ring_scale = Slider(2.33, range=0..3)
ring_x = Slider(-0.752, range=-1..0)
ring_z = Slider(0.564, range=0.5..2)

geo = Geometry(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)

# ----
# Slicing parameters
filament_width = Slider(19.5, range=10..25)
layer_number = Slider(25, range=0..100)
layer_height = Slider(14, range=10..30)
list_3 = ValueList({"Single layer": 0, "All layers": 1}, selected="Single layer")

# ----
# CEM - Metric Input
# Hoop in Tension
# Connectors between
# Legs and Pretension
cem_input = CEMInput(
    A=list_2,
    B=Slider(8.9, range=0..50),
    L=radial_deviations,
    B_2=Slider(3.8, range=0..20),
    A_2=list,
    B_3=Slider(1.6, range=0.1..2),
    L_2=line)  # -> D, D_2, D_3, R, R_2
cem_point_loads = CEMPointLoads(D_2=dam_2, D=cluster.pt_2)  # -> D_3, D_5, i, D_4, L
cem_set_up = CEMSetUp(
    deviationedge_2=radial_deviations,
    deviationmagn_2=cem_input.D,
    deviationedge_3=radial_deviations_2,
    deviationmagn_3=cem_input.D_2,
    deviationedge=line,
    deviationmagn=cem_input.D_3,
    trailedge=trails_2,
    traillen=cem_input.R,
    trailedge_2=trails,
    traillen_2=cem_input.R_2,
    support=[support_nodes_2, support_nodes],
    pointload=cem_point_loads.i,
    loadmagnx=cem_point_loads.D_3,
    loadmagny=cem_point_loads.D_3,
    loadmagnz=cem_point_loads.D_5,
    pointload_2=cem_point_loads.L,
    loadmagnx_2=cem_point_loads.D_4,
    loadmagny_2=cem_point_loads.D_4,
    loadmagnz_2=dam)  # -> D, D_2, D_3, T, T_2, S, L, L_2

# ----
# CEM - Structure
# Definition of the Origin Nodes
# Input
# Solution
# Visualization
cem_build_topology = CEM_Build_Topology(
    T=flatten([cem_set_up.T, cem_set_up.T_2]),
    L=flatten([cem_set_up.L, cem_set_up.L_2]),
    D=flatten([cem_set_up.D, cem_set_up.D_2, cem_set_up.D_3]),
    S=flatten(cem_set_up.S))
cem_extract_topology = CEM_Extract_Topology(TP=cem_build_topology)  # -> Nodes, NodesID, Edges, EdgesID, ConstraintPlane, ConstraintPlaneID, OriginNode, OriginNodeID

cluster_2 = Cluster_4(
    K=cem_extract_topology.ConstraintPlaneID,
    L_3=n_tangential,
    L_4=n_tangential,
    S=origin_nodes,
    N=n_tangential,
    L=number_slider,
    N_2=n_tangential,
    L_2=Slider(2.7, range=0.1..10))  # -> panel_3, D

cem_constraint_plane = CEM_Constraint_Plane(ConstraintPlane=flatten(cluster_2.D), ConstraintPlaneID=cluster_2.panel_3)

cluster_3 = Cluster_3(
    G=cem_extract_topology.OriginNode,
    F=height,
    X=scaling_factor,
    Y=scaling_factor,
    originnodeid=cem_extract_topology.OriginNodeID)

# ----
# CEM - Evaluation
# Reference Leg for Materialization
# Normal Forces from Top to Button
# Safety Factor for Materialization
# Roof Elements
number_slider_2 = Slider(15, range=0..20)

cem_calculate_structure = CEM_Calculate_Structure(TP=cem_build_topology, CPL=cem_constraint_plane, N=cluster_3)
cem_extract_structure = CEM_Extract_Structure(M=cem_calculate_structure)  # -> Nodes, NodesID, Trails, TrailsID, TrailsCol, TrailsMag, Deviations, DeviationsID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

# ----
# Leg
legs = Legs(L=cem_extract_structure.Trails, A=cem_extract_structure.TrailsMag, S=n_radial)  # -> pl, P
roof_elements = RoofElements(A=cem_extract_structure.DeviationsMag, C=cem_extract_structure.Deviations, B=height)  # -> A_2, S
py3 = Python3Script(legs=flatten(legs.pl))  # -> leg_out; inputs legs: list
# ---------- py3: Python ----------
from Rhino.Geometry import Polyline, GeometryBase, Plane, Vector3d, Point3d
import math

for leg in legs:
    if abs(leg.PointAt(0)[1]) < 0.001 and leg.PointAt(0)[0] > 0:
        leg_out = leg
# ---------- end py3 ----------
panel_2 = Panel(legs.P)
explode = Explode(Curve=py3, Recursive=True)  # -> Segments, Vertices
neg = Negative(Value=panel_2)
reparamcrv = ReparameterizeCurve(Curve=explode.Segments)  # -> Reparameterized, Original
multiplication = Multiplication(A=neg, B=number_slider_2)

cluster_4 = Cluster_2(
    pt=cem_extract_structure.Nodes,
    geo=[cem_extract_structure.Trails, cem_extract_structure.Deviations],
    Panel=[cem_extract_structure.TrailsMag, cem_extract_structure.DeviationsMag])  # -> M, simplify(P_2), simplify(P), R

# ----
# Materialization
# This part of the tool takes in the results of the CEM simulation and applies cross-sections to the structural model based on parameters defined by the user. The crossections are lofted to create building components. The load resulting from the weight of the components is reapplied in the form finding part process.
tag = TextTag3D(Location=cluster_4.M, Text=cluster_4.R, Size=0.3, Colour=ColourSwatch(SwatchColor=RGBA(0, 0, 0, 153)), Justification=7)
legs_2 = CustomPreview(Geometry=cluster_4.P_2, Material=ColourSwatch(SwatchColor=RGBA(33, 50, 237, 92)))
legs_3 = CustomPreview(Geometry=cluster_4.P, Material=ColourSwatch(SwatchColor=RGBA(224, 11, 11, 92)))

# ----
# Script
# This python script applies cross-sections to the CEM model.
materialization = Python3Script(
    n=n_radial,
    segments=reparamcrv.Reparameterized,
    forces=multiplication,
    k1_top=Slider(0.32, range=0.15..1.2),
    middle_x=middle_x,
    middle_z=middle_z,
    k1_bottom=Slider(1.2, range=0.2..1.2),
    ring_x=ring_x,
    ring_z=ring_z,
    ring_scale=ring_scale)  # -> leg, leg_top, ring, sections, ring_polylines, alpha; inputs n: Int32, segments: list, forces: list, k1_top: Double, middle_x: Double, k1_bottom: Double, ring_x: Double
# ---------- materialization: Python ----------
import Rhino
import math

from Rhino.Geometry import Point3d, Vector3d, Plane, Line, Polyline, Curve, NurbsCurve, Transform, Brep, Intersect, LoftType
#Material Parameters - compressive strength in [kN/m²]
compressive_strength = 1500

def apply_polyline(k1,alpha, segment,force,compressive_strength):
    
    # Calculate k2 from k1 and the compressive strength
    k2 = force/(compressive_strength*k1)

    # Create points and polyline
    p1 = Point3d(0,0,0)
    p2 = Point3d(-k2,k2/math.tan(alpha),0)
    p3 = Point3d(0,k1,0)
    p4 = Point3d(k2,k2/math.tan(alpha),0)

    points = [p1, p2, p3, p4, p1]
    polyline = Polyline(points)

    # Define origin plane 
    origin_plane = Plane(Point3d(0, k1 / 2, 0), Vector3d.XAxis, -Vector3d.ZAxis)
          
    # Define aligned frame
    aligned_frame = Plane(segment.FrameAt(0.5)[1].Origin, Vector3d.YAxis, segment.FrameAt(0.5)[1].XAxis)

    # Transform polyline to aligned frame
    T = Transform.PlaneToPlane(origin_plane, aligned_frame)
    polyline.Transform(T)

    # Output the polyline and points
    return polyline, polyline.ToArray()


# Compute the angle alpha
alpha = ((n-2)*math.pi)/(2*n)

# Create top and bottom polylines
top_polyline, top_points = apply_polyline(k1_top, alpha, segments[0], forces[0], compressive_strength)
bottom_polyline, bottom_points = apply_polyline(k1_bottom, alpha, segments[-1], forces[-1], compressive_strength)

# Calculate middle point and transform using middle_y and middle_z
middle_point = Point3d(
    (top_points[2].X + bottom_points[2].X) / 2,
    (top_points[2].Y + bottom_points[2].Y) / 2,
    (top_points[2].Z + bottom_points[2].Z) / 2,
)
middle_point.Transform(Transform.Translation(middle_x, 0, middle_z))

# Create curve through top, middle, and bottom points
curve = NurbsCurve.Create(False, 2, [top_points[2], middle_point, bottom_points[2]])

# Iterate over segments and generate polyline sections
intersection_points = []
sections = []

for i, segment in enumerate(segments):
    frame = segment.FrameAt(0.5)[1]
    aligned_frame = Plane(frame.Origin, frame.ZAxis, frame.YAxis)
    intersection = Intersect.Intersection.CurvePlane(curve, aligned_frame, 0.001)[0].PointA   

    # Calculate k1
    k1 = 2 * intersection.DistanceTo(frame.Origin)
    k1 = k1_top if i == 0 else k1_bottom if i == len(segments) - 1 else k1

    # Generate polyline
    polyline, points = apply_polyline(k1, alpha, segment, forces[i], compressive_strength)

    if i == 0:
        # Scale and translate the top polyline
        ring_polyline = polyline.Duplicate()
        ring_polyline.Transform(Transform.Scale(frame.Origin, ring_scale))
        ring_polyline.Transform(Transform.Translation(ring_x, 0, ring_z))
        ring_points = ring_polyline.ToArray()

        # Define additional ring polylines 
        ring_polyline_1 = Polyline([points[3], ring_points[2], ring_points[0], points[3]])
        ring_polyline_2 = Polyline([points[1], ring_points[2], ring_points[0], points[1]])
        ring_polyline_3 = Polyline([points[2], points[3], ring_points[2], points[2]])
        ring_polyline_4 = Polyline([points[2], points[1], ring_points[2], points[2]])
        ring_polyline_5 = Polyline([points[0], points[3], ring_points[0], points[0]])
        ring_polyline_6 = Polyline([points[0], points[1], ring_points[0], points[0]])

        # Store all polylines in a list
        ring_polylines = [ring_polyline_1,ring_polyline_2,ring_polyline_3,ring_polyline_4,ring_polyline_5,ring_polyline_6]

        # Generate planar Breps from polylines
        leg_top = [Brep.CreatePlanarBreps(poly.ToNurbsCurve())[0] for poly in ring_polylines]

        # Apply rotation to ring_polyline_2
        loft_ring_polyline_2 = ring_polyline_2.Duplicate()
        loft_ring_polyline_2.Transform(Transform.Rotation(math.pi - 2 * alpha, Point3d.Origin))

        # Loft the ring polylines to create keystones
        loft_type = LoftType.Straight
        ring = Brep.CreateFromLoft([ring_polyline_1.ToNurbsCurve(),loft_ring_polyline_2.ToNurbsCurve()], Point3d.Unset, Point3d.Unset, loft_type, False)
        ring_polylines = [ring_polyline_1.ToNurbsCurve(),loft_ring_polyline_2.ToNurbsCurve()]

    sections.append(polyline.ToNurbsCurve())

leg = []

# Generate building components by lofting the setions
for i, section in enumerate(sections[:-1]):  
    leg.append(
        Brep.CreateFromLoft(
            [sections[i], sections[i+1]],  
            Point3d.Unset,
            Point3d.Unset,
            loft_type,
            False
        )[0]
    )
# ---------- end materialization ----------

# ----
# Visualization
# Here you can visualize the legs, the top leg piece as well as the ring.
pavilion_geometry = PavilionGeometry(G=materialization.leg, B_2=materialization.leg_top, N=n_radial, B=materialization.ring)  # -> B_5, B_3, G_3, G_2, B_4
legs_4 = CustomPreview(Geometry=pavilion_geometry.B_5, Material=ColourSwatch(SwatchColor=RGBA(237, 230, 102, 92)))
leg_top = CustomPreview(Geometry=pavilion_geometry.G_3, Material=ColourSwatch(SwatchColor=RGBA(237, 230, 102, 92)))
ring = CustomPreview(Geometry=pavilion_geometry.G_2, Material=ColourSwatch(SwatchColor=RGBA(240, 185, 36, 107)))

# ----
# Updated loading
# As a result of the chosen cross-section and the material parameters, the proper dead weight of the structure is calculated, saved in a .ghdate file and iteratively applied to the FormFinding Process.
# Additional Roof Loading Dead Weight and Snow Load can be applied.
additional_dead_weight_roof_kn_m² = Slider(2, range=0..10)
snow_load_roof_kn_m² = Slider(2, range=0..5)
updated_dead_weight = UpdatedDeadWeight(
    E=roof_elements.S,
    g=additional_dead_weight_roof_kn_m²,
    s=snow_load_roof_kn_m²,
    n=n_radial,
    G=pavilion_geometry.B_3,
    G_2=pavilion_geometry.B_4,
    G_3=pavilion_geometry.B_5)  # -> R, R_2
panel_3 = Panel(updated_dead_weight.R)
panel_4 = Panel(updated_dead_weight.R_2)
output = DataOutput(
    DataInput=panel_3,
    Destination="C:\Users\Ema Krakovska\Downloads\250107_Roof_Load.ghdata",
    RelativePath="C:\Users\Ema Krakovska\Downloads\250107_Roof_Load.ghdata|..\..\..\Downloads\250107_Roof_Load.ghdata")
output_2 = DataOutput(
    DataInput=panel_4,
    Destination="C:\Users\Ema Krakovska\Downloads\250107_Legs_Load.ghdata",
    RelativePath="C:\Users\Ema Krakovska\Downloads\250107_Legs_Load.ghdata|..\..\..\Downloads\250107_Legs_Load.ghdata")

# ----
# Connection details
# In this part of the tool, you can add connection details to your segmented geometry before slicing it. This connection is only one option. Feel free to develop your own.
connection_height = Slider(0.14, range=0..0.15)

# ----
# Component preparation
# Select the component you want to slice and adjust the orientation in the particle bed for optimal layering.
rotation_degrees = Slider(0, range=-180..180)
# Custom component input
# Component selection
leg_component = Slider(5, range=0..10)
move_in_z = Slider(0, range=0..0.5)
list_4 = ValueList({"Leg": 0, "Leg top": 1, "Ring": 2, "Custom": 3}, selected="Leg")

connection_details = ConnectionDetails(
    B=materialization.ring,
    L_3=materialization.ring_polylines,
    L=materialization.leg_top,
    B_2=connection_height,
    L_2=materialization.sections,
    i=leg_component)  # -> R_2, R_3, R

component = Component(
    leg=connection_details.R,
    leg_top=connection_details.R_3,
    ring=connection_details.R_2,
    custom=geo,
    alpha=materialization.alpha,
    B=particle_bed.cv,
    G=list_4,
    i=leg_component,
    D=rotation_degrees,
    F=move_in_z)

# ----
# Slicer
# The slicer takes in the selected compnent and generates a toolpath for the given layer height and filament width.
contour = Contour(geometry=component, layer_height=layer_height)  # -> simplify(C)
# ! This section is in millimiters !
cluster_5 = Cluster_5(component=list_3, layer_number=layer_number, C=component, B=layer_height)
scale = Scale(Geometry=contour, Center=Point(0, 0, 0), Factor=0.001)  # -> Geometry, Transform
preview_2 = CustomPreview(Geometry=scale.Geometry, Material=ColourSwatch(SwatchColor=RGBA(187, 222, 164, 184)))

offset = Offset(N=filament_width, T=contour, P=cluster_5)

scale_2 = Scale(Geometry=offset, Center=Point(0, 0, 0), Factor=0.001)  # -> simplify(Geometry), Transform
preview_3 = CustomPreview(Geometry=scale_2.Geometry, Material=ColourSwatch(SwatchColor=RGB(207, 97, 58)))

# ==== cluster RoofElements
C = ClusterInput()
end = EndPoints(Curve=C)  # -> Start, End
A = ClusterInput()
B = ClusterInput()
pdecon = Deconstruct(Point=end.End)  # -> XComponent, YComponent, ZComponent
pdecon_2 = Deconstruct(Point=end.Start)  # -> XComponent, YComponent, ZComponent
smaller = SmallerThan(FirstNumber=A, SecondNumber=0)  # -> SmallerThan, OrEqualTo
equals = Equality(FirstNumber=pdecon_2.ZComponent, SecondNumber=B)  # -> Equality, Inequality
equals_2 = Equality(FirstNumber=pdecon.ZComponent, SecondNumber=B)  # -> Equality, Inequality
dispatch = Dispatch(List=C, DispatchPattern=smaller.SmallerThan)  # -> ListA, ListB
dispatch_2 = Dispatch(List=A, DispatchPattern=smaller.SmallerThan)  # -> ListA, ListB
dispatch_3 = Dispatch(List=end.End, DispatchPattern=equals_2.Equality)  # -> ListA, ListB
dispatch_4 = Dispatch(List=end.Start, DispatchPattern=equals.Equality)  # -> ListA, ListB
pt = Point(dispatch_3.ListA)
pt_2 = Point(dispatch_4.ListA)
duppt = RemoveDuplicatePts(Points=[pt_2, pt], Tolerance=0.01)
hull = ConvexHull(Points=duppt, Plane=PlaneXY(0, 0, 0))  # -> Hull, HullZ, Indices
explode = Explode(Curve=hull.HullZ, Recursive=True)  # -> Segments, Vertices
similar = Similarity(FirstNumber=dispatch.ListA, SecondNumber=explode.Segments, Threshold=5e-05)  # -> Similarity, AbsoluteDifference
dispatch_5 = Dispatch(List=dispatch_2.ListA, DispatchPattern=similar.Similarity)  # -> ListA, ListB
A_2 = ClusterOutput(dispatch_5.ListA)
S = ClusterOutput(explode.Segments)

# ==== cluster Cluster
relay = ClusterInput()
dom = ConstructDomain(DomainStart="1", DomainEnd="10")
range = Range(Domain=dom, Steps=relay)
cir = Circle(Plane=PlaneXY(0, 0, 0), Radius=range)
N = ClusterInput()
F = ClusterInput()
divide = DivideCurve(Curve=cir, Count=N, Kinks=False)  # -> simplify(Points), Tangents, Parameters
Z = UnitZ(Factor=F)
flip = FlipMatrix(Data=divide.Points)
shift = ShiftList(List=flip, Shift=1, Wrap=invert(True))
cull_i = CullIndex(List=flip, Indices=-1, Wrap=True)
shift_2 = ShiftList(List=divide.Points, Shift=1, Wrap=True)
ln = Line(StartPoint=simplify(cull_i), EndPoint=simplify(shift))
ln_2 = Line(StartPoint=simplify(divide.Points), EndPoint=simplify(shift_2))
repeat = RepeatData(Data=graft("True"), Length=relay)  # -> flatten(Data)
L = ClusterOutput(ln)
L_2 = ClusterOutput(ln_2)
entwine = Entwine(Branch0X=divide.Points, Branch1X=ln, Branch2X=ln_2, FlattenInputs=False)  # -> simplify(Result)
move = Move(Geometry=entwine, Motion=Z)  # -> Geometry, Transform
split = SplitTree(Data=move.Geometry, Masks=flatten("{0;?}"))  # -> simplify(Positive), Negative
split_2 = SplitTree(Data=move.Geometry, Masks=flatten("{1;?}"))  # -> simplify(Positive), Negative
split_3 = SplitTree(Data=move.Geometry, Masks=flatten("{2;?}"))  # -> simplify(Positive), Negative
P = ClusterOutput(split_2.Positive)
ln_3 = Line(StartPoint=simplify(flatten(divide.Points)), EndPoint=simplify(flatten(split.Positive)))
P_2 = ClusterOutput(split_3.Positive)
ln_4 = Line(StartPoint=simplify(divide.Points), EndPoint=simplify(split.Positive))
flip_2 = FlipMatrix(Data=ln_4)
panel = Panel([repeat, "False"])
pt = Point(divide.Points)
dispatch = Dispatch(List=flip_2, DispatchPattern=panel)  # -> ListA, ListB
pt_2 = ClusterOutput(pt)
A = ClusterOutput(dispatch.ListA)
split_4 = SplitTree(Data=pt, Masks="{0}")  # -> Positive, Negative
concat = Concatenate(FragmentA="{", FragmentB=relay, FragmentC="}")
concat_2 = Concatenate(FragmentA="{", FragmentB=relay, FragmentC="}")
P_3 = ClusterOutput(split_4.Positive)
split_5 = SplitTree(Data=pt, Masks=concat)  # -> Positive, Negative
split_6 = SplitTree(Data=split.Positive, Masks=concat_2)  # -> Positive, Negative
P_4 = ClusterOutput(split_5.Positive)
P_5 = ClusterOutput(split_6.Positive)

# ==== cluster PavilionGeometry
B = ClusterInput()
B_2 = ClusterInput()
join = BrepJoin(Breps=B)  # -> Breps, Closed
join_2 = BrepJoin(Breps=B_2)  # -> Breps, Closed
cap = CapHoles(Brep=join.Breps)
cap_2 = CapHoles(Brep=join_2.Breps)
B_3 = ClusterOutput(cap_2)
B_4 = ClusterOutput(cap)
N = ClusterInput()
G = ClusterInput()
arrpolar = PolarArray(Geometry=cap, Plane=PlaneXY(0, 0, 0), Count=N, Angle=6.283185307)  # -> flatten(Geometry), Transform
arrpolar_2 = PolarArray(Geometry=cap_2, Plane=PlaneXY(0, 0, 0), Count=N, Angle=6.283185307)  # -> flatten(Geometry), Transform
arrpolar_3 = PolarArray(Geometry=G, Plane=PlaneXY(0, 0, 0), Count=N, Angle=6.283185307)  # -> simplify(Geometry), Transform
flip = FlipMatrix(Data=arrpolar_3.Geometry)
G_2 = ClusterOutput(arrpolar.Geometry)
G_3 = ClusterOutput(arrpolar_2.Geometry)
geo = Geometry(flip)
cap_3 = CapHoles(Brep=geo)
B_5 = ClusterOutput(cap_3)

# ==== cluster UpdatedDeadWeight
gamma_kn_m³ = Slider(18.7, range=0..30)
E = ClusterInput()
boundary = BoundarySurfaces(Edges=E)
G = ClusterInput()
G_2 = ClusterInput()
area = Area(Geometry=boundary)  # -> simplify(flatten(Area)), Centroid
geo = Geometry(G_2)
volume = Volume(Geometry=G_2)  # -> Volume, Centroid
volume_2 = Volume(Geometry=G)  # -> Volume, Centroid
panel = Panel(area.Area)
expression = Expression(V=volume.Volume, gamma=gamma_kn_m³, Expression="-V*gamma*1.35")
expression_2 = Expression(V=volume_2.Volume, gamma=gamma_kn_m³, Expression="-V*gamma*1.35")
g = ClusterInput()
s = ClusterInput()
n = ClusterInput()
G_3 = ClusterInput()
expression_3 = Expression(x=panel, g=g, s=s, n=n, Expression="-x/n*(1.35*g+1.5*s)")
volume_3 = Volume(Geometry=G_3)  # -> Volume, Centroid
addition = Addition(A=expression_3, B=expression_2, C=expression)
expression_4 = Expression(V=volume_3.Volume, gamma=gamma_kn_m³, Expression="-V*gamma*1.35")
R = ClusterOutput(addition)
panel_2 = Panel(expression_4)
R_2 = ClusterOutput(expression_4)

# ==== cluster Legs
A = ClusterInput()
larger = LargerThan(FirstNumber=A, SecondNumber=1e-05)  # -> LargerThan, OrEqualTo
L = ClusterInput()
dispatch = Dispatch(List=A, DispatchPattern=larger.LargerThan)  # -> ListA, flatten(ListB)
dispatch_2 = Dispatch(List=L, DispatchPattern=larger.LargerThan)  # -> ListA, ListB
S = ClusterInput()
legs_compression = Line(dispatch_2.ListB)
equals = Equality(FirstNumber=dispatch.ListB, SecondNumber=0)  # -> Equality, Inequality
dispatch_3 = Dispatch(List=dispatch_2.ListB, DispatchPattern=equals.Inequality)  # -> ListA, flatten(ListB)
dispatch_4 = Dispatch(List=dispatch.ListB, DispatchPattern=equals.Inequality)  # -> flatten(ListA), flatten(ListB)
partition = PartitionList(List=dispatch_4.ListA, Size=S)
panel = Panel(partition)
flip = FlipMatrix(Data=partition)  # -> simplify(Data)
split = SplitTree(Data=flip, Masks=flatten("{0}"))  # -> simplify(Positive), Negative
end = EndPoints(Curve=dispatch_3.ListA)  # -> Start, End
P = ClusterOutput(split.Positive)
duppt = RemoveDuplicatePts(Points=[end.Start, end.End], Tolerance=0.01)
partition_2 = PartitionList(List=duppt, Size=S)
flip_2 = FlipMatrix(Data=partition_2)  # -> simplify(Data)
pline = PolyLine(Vertices=flip_2, Closed=False)
pl = ClusterOutput(pline)

# ==== cluster Cluster_2
geo = ClusterInput()
pt = ClusterInput()
panel = Panel(ClusterInput())
geo_2 = Geometry(geo)
pt_2 = Point(pt)
number_slider = Slider(500, range=0..5000)
midpt = CurveMiddle(Curve=geo_2)
roundd = RoundToDecimalPlace(NumberX=panel, DecimalPlace=2, RoundType=0)  # -> Rounded, Difference
smaller = SmallerThan(FirstNumber=panel, SecondNumber=0)  # -> SmallerThan, OrEqualTo
R = ClusterOutput(roundd.Rounded)
M = ClusterOutput(midpt)
dispatch = Dispatch(List=panel, DispatchPattern=smaller.SmallerThan)  # -> ListA, ListB
division = Division(A=dispatch.ListA, B=number_slider)
division_2 = Division(A=dispatch.ListB, B=number_slider)
dispatch_2 = Dispatch(List=geo_2, DispatchPattern=smaller.SmallerThan)  # -> ListA, ListB
pipe = Pipe(Curve=dispatch_2.ListB, Radius=division_2, Caps=0)
pipe_2 = Pipe(Curve=dispatch_2.ListA, Radius=expr("-x", division), Caps=0)
P = ClusterOutput(pipe)
P_2 = ClusterOutput(pipe_2)

# ==== cluster CEMInput
list = ValueList({"Tension": 1, "Compression": -1, "Null": 0}, selected="Compression")
A = ClusterInput()
B = ClusterInput()
multiplication = Multiplication(A=A, B=B)
panel = Panel([multiplication, "0"])
L = ClusterInput()
lng = ListLength(List=L)
B_2 = ClusterInput()
repeat = RepeatData(Data=graft(panel), Length=lng)  # -> simplify(Data)
D = ClusterOutput(repeat)
lng_2 = ListLength(List=L)
A_2 = ClusterInput()
multiplication_2 = Multiplication(A=A_2, B=B_2)
panel_2 = Panel([multiplication_2, "0"])
B_3 = ClusterInput()
repeat_2 = RepeatData(Data=graft(panel_2), Length=lng_2)  # -> simplify(Data)
L_2 = ClusterInput()
multiplication_3 = Multiplication(A=A_2, B=B_3)
lng_3 = ListLength(List=L_2)
D_2 = ClusterOutput(repeat_2)
repeat_3 = RepeatData(Data=multiplication_3, Length=lng_3)  # -> simplify(Data)
multiplication_4 = Multiplication(A=A_2, B="1")
multiplication_5 = Multiplication(A=list, B="1")
D_3 = ClusterOutput(repeat_3)
R = ClusterOutput(multiplication_4)
R_2 = ClusterOutput(multiplication_5)

# ==== cluster CEMPointLoads
D = ClusterInput()
flip = FlipMatrix(Data=D)
panel = Panel("""0
-1""")
item = ListItem(List=flip, Index=0, Wrap=True)
cull_i = CullIndex(List=flip, Indices=panel, Wrap=True)  # -> simplify(List)
i = ClusterOutput(item)
lng = ListLength(List=item)
pt = Point(flatten(cull_i))
L = ClusterOutput(cull_i)
D_2 = ClusterInput()
lng_2 = ListLength(List=pt)
repeat = RepeatData(Data=0, Length=lng)  # -> simplify(Data)
repeat_2 = RepeatData(Data=flatten(D_2), Length=lng)  # -> simplify(Data)
repeat_3 = RepeatData(Data=0, Length=lng_2)
D_3 = ClusterOutput(repeat)
D_4 = ClusterOutput(repeat_3)
D_5 = ClusterOutput(repeat_2)

# ==== cluster CEMSetUp
deviationedge = ClusterInput()
deviationmagn = ClusterInput()
deviationedge_2 = ClusterInput()
deviationmagn_2 = ClusterInput()
deviationedge_3 = ClusterInput()
deviationmagn_3 = ClusterInput()
pointload = ClusterInput()
loadmagnx = ClusterInput()
loadmagny = ClusterInput()
loadmagnz = ClusterInput()
pointload_2 = ClusterInput()
loadmagnx_2 = ClusterInput()
loadmagny_2 = ClusterInput()
loadmagnz_2 = ClusterInput()
trailedge = ClusterInput()
traillen = ClusterInput()
trailedge_2 = ClusterInput()
traillen_2 = ClusterInput()
support = ClusterInput()
cem_deviation = CEM_Deviation(DeviationEdge=simplify(deviationedge), DeviationMagn=expr("-x", deviationmagn))
cem_deviation_2 = CEM_Deviation(DeviationEdge=deviationedge_2, DeviationMagn=deviationmagn_2)
cem_deviation_3 = CEM_Deviation(DeviationEdge=deviationedge_3, DeviationMagn=deviationmagn_3)
cem_load = CEM_Load(PointLoad=flatten(pointload), LoadMagnX=flatten(loadmagnx), LoadMagnY=flatten(loadmagny), LoadMagnZ=flatten(loadmagnz))
cem_load_2 = CEM_Load(
    PointLoad=flatten(pointload_2),
    LoadMagnX=flatten(loadmagnx_2),
    LoadMagnY=flatten(loadmagny_2),
    LoadMagnZ=flatten(loadmagnz_2))
cem_trail = CEM_Trail(TrailEdge=trailedge, TrailLen=traillen)
cem_trail_2 = CEM_Trail(TrailEdge=trailedge_2, TrailLen=traillen_2)
cem_support = CEM_Support(Support=support)
D = ClusterOutput(cem_deviation_2)
D_2 = ClusterOutput(cem_deviation_3)
D_3 = ClusterOutput(cem_deviation)
T = ClusterOutput(cem_trail)
T_2 = ClusterOutput(cem_trail_2)
S = ClusterOutput(cem_support)
L = ClusterOutput(cem_load)
L_2 = ClusterOutput(cem_load_2)

# ==== cluster Cluster_3
X = ClusterInput()
Y = ClusterInput()
F = ClusterInput()
G = ClusterInput()
Z = UnitZ(Factor=F)
originnodeid = ClusterInput()
move = Move(Geometry=G, Motion=graft(Z))  # -> Geometry, Transform
scale_nu = ScaleNU(Geometry=move.Geometry, Plane=PlaneXY(0, 0, 0), ScaleX=X, ScaleY=Y, ScaleZ=1)  # -> Geometry, Transform
cem_origin_node = CEM_Origin_Node(OriginNode=flatten(scale_nu.Geometry), OriginNodeID=flatten(originnodeid))
avr = Average(Input=move.Geometry)
xy = XYPlane(Origin=avr)
N = ClusterOutput(cem_origin_node)

# ==== cluster Cluster_4
S = ClusterInput()
L = ClusterInput()
L_2 = ClusterInput()
Z = UnitZ(Factor=1)
pt = Point(Point(0, 0, 0))
N = ClusterInput()
line = LineSDL(Start=S, Direction=Vector(0, 0, 1), Length=L)
line_2 = LineSDL(Start=pt, Direction=Z, Length=L_2)
N_2 = ClusterInput()
divide = DivideCurve(Curve=line, Count=N, Kinks=False)  # -> reverse(simplify(Points)), simplify(Tangents), Parameters
item = ListItem(List=line, Index=0, Wrap=True)
divide_2 = DivideCurve(Curve=line_2, Count=N_2, Kinks=False)  # -> reverse(Points), Tangents, Parameters
geo = Geometry(item)
panel = Panel(divide.Points)
lng = ListLength(List=divide.Points)
repeat = RepeatData(Data=divide_2.Points, Length=lng)  # -> simplify(Data)
bang = ExplodeTree(Data=divide.Points)  # -> Branch0, Branch1
L_3 = ClusterInput()
L_4 = ClusterInput()
K = ClusterInput()
vec2pt = Vector2Pt(PointA=repeat, PointB=divide.Points, Unitize=False)  # -> Vector, Length
repeat_2 = RepeatData(Data=graft("True"), Length=L_3)  # -> simplify(Data)
repeat_3 = RepeatData(Data=graft("False"), Length=L_4)  # -> simplify(Data)
geo_2 = Geometry(bang.Branch0)
sort = SortList(Keys=K)  # -> Keys, ValuesA
xprod = CrossProduct(VectorA=divide.Tangents, VectorB=vec2pt.Vector, Unitize=False)  # -> Vector, Length
dispatch = Dispatch(List=sort.Keys, DispatchPattern=[repeat_2, repeat_3])  # -> ListA, ListB
lng_2 = ListLength(List=sort.Keys)
pl = ConstructPlane(Origin=divide.Points, XAxis=xprod.Vector, YAxis=vec2pt.Vector)
panel_2 = Panel([dispatch.ListA, dispatch.ListB])
cull_i = CullIndex(List=pl, Indices=0, Wrap=True)  # -> simplify(List)
bang_2 = ExplodeTree(Data=cull_i)  # -> Branch0, Branch1
geo_3 = Geometry(bang_2.Branch0)
panel_3 = ClusterOutput(panel_2)
repeat_4 = RepeatData(Data=flatten(cull_i), Length=lng_2)  # -> simplify(Data)
D = ClusterOutput(repeat_4)

# ==== cluster ParticleBed
A = ClusterInput()
division = Division(A=A, B=2)
A_2 = ClusterInput()
division_2 = Division(A=A_2, B=2)
neg = Negative(Value=division)
neg_2 = Negative(Value=division_2)
dom = ConstructDomain(DomainStart=neg_2, DomainEnd=division_2)
dom_2 = ConstructDomain(DomainStart=neg, DomainEnd=division)
rectangle = Rectangle(Plane=PlaneXY(0, 0, 0), XSize=dom, YSize=dom_2, Radius=0)  # -> Rectangle, Length
H = ClusterInput()
pcen = PolygonCenter(Polyline=rectangle.Rectangle)  # -> CenterV, CenterE, CenterA
boxrec = BoxRectangle(Rectangle=rectangle.Rectangle, Height=H)
cv = ClusterOutput(pcen.CenterV)
B = ClusterOutput(boxrec)

# ==== cluster Contour
layer_height = ClusterInput()
geometry = ClusterInput()
contour = Contour(Geometry=geometry, Point=Point(0, 0, 0), Direction=Vector(0, 0, 1), LayerHeight=layer_height)
simplify = SimplifyCurve(Curve=contour)  # -> Curve, Simplified
C = ClusterOutput(contour)

# ==== cluster Component
custom = ClusterInput()  # Custom
alpha = ClusterInput()
leg = ClusterInput()
leg_top = ClusterInput()
ring = ClusterInput()
addition = Addition(A=alpha, B=4.71238898)
custom_2 = Geometry(custom)
leg_2 = Geometry(leg)
ring_2 = Geometry(ring)
leg_top_2 = Geometry(leg_top)
B = ClusterInput()
join = BrepJoin(Breps=leg_top_2)  # -> Breps, Closed
rotate = Rotate(Geometry=ring_2, Angle=addition, Plane=PlaneXY(0, 0, 0))  # -> Geometry, Transform
G = ClusterInput()
i = ClusterInput()
item = ListItem(List=leg_2, Index=i, Wrap=True)
cap = CapHoles(Brep=item)
cap_2 = CapHoles(Brep=join.Breps)
cap_3 = CapHoles(Brep=rotate.Geometry)
component = StreamFilter(Gate=G, Stream0=cap, Stream1=cap_2, Stream2=cap_3, Stream3=custom_2)
component_2 = Geometry(component)
D = ClusterInput()
bbox = BoundingBox(Content=component_2, Plane=PlaneXY(0, 0, 0))  # -> Box, Box_2
boxprop = BoxProperties(Box=bbox.Box)  # -> Center, Diagonal, Area, Volume, Degeneracy
rad = Radians(Degrees=D)
xz = XZPlane(Origin=boxprop.Center)
rotate_2 = Rotate(Geometry=component_2, Angle=rad, Plane=xz)  # -> Geometry, Transform
bbox_2 = BoundingBox(Content=rotate_2.Geometry, Plane=PlaneXY(0, 0, 0))  # -> Box, Box_2
debox = DeconstructBox(Box=bbox_2.Box)  # -> Plane, X, Y, Z
dedomain = DeconstructDomain(Domain=debox.X)  # -> Start, End
dedomain_2 = DeconstructDomain(Domain=debox.Y)  # -> Start, End
dedomain_3 = DeconstructDomain(Domain=debox.Z)  # -> Start, End
avr = Average(Input=[dedomain.End, dedomain.Start])
avr_2 = Average(Input=[dedomain_2.Start, dedomain_2.End])
pt = ConstructPoint(XCoordinate=avr, YCoordinate=avr_2, ZCoordinate=dedomain_3.Start)
F = ClusterInput()
vec2pt = Vector2Pt(PointA=pt, PointB=B, Unitize=False)  # -> Vector, Length
Z = UnitZ(Factor=F)
move = Move(Geometry=rotate_2.Geometry, Motion=vec2pt.Vector)  # -> Geometry, Transform
move_2 = Move(Geometry=move.Geometry, Motion=Z)  # -> Geometry, Transform
scale = Scale(Geometry=move_2.Geometry, Center=Point(0, 0, 0), Factor=Slider(1000, range=0..1000))  # -> Geometry, Transform
G_2 = ClusterOutput(scale.Geometry)

# ==== cluster ConnectionDetails
L = ClusterInput()
L_2 = ClusterInput()
B = ClusterInput()
i = ClusterInput()
addition = Addition(A=i, B=1)
join = BrepJoin(Breps=B)  # -> Breps, Closed
join_2 = BrepJoin(Breps=L)  # -> Breps, Closed
item = ListItem(List=L, Index=Slider(0, range=0..5), Wrap=True)
item_2 = ListItem(List=L_2, Index=addition, Wrap=True)
item_3 = ListItem(List=L_2, Index=Slider(0, range=0..5), Wrap=True)
item_4 = ListItem(List=L, Index=Slider(1, range=0..5), Wrap=True)
item_5 = ListItem(List=L_2, Index=i, Wrap=True)
cap = CapHoles(Brep=join.Breps)
L_3 = ClusterInput()
cap_2 = CapHoles(Brep=join_2.Breps)
loft = Loft(
    Curves=[item_5, item_2],
    Options={Adjust=False, Closed=False, LoftEnds=0, LoftSimp=0, LoftType=0, Rebuild=10, Refit=0.01})
planar = Planar(Curve=item_2)  # -> Planar, Plane, Deviation
planar_2 = Planar(Curve=item_5)  # -> Planar, Plane, Deviation
item_6 = ListItem(List=L_3, Index=Slider(1, range=0..1), Wrap=True)
cap_3 = CapHoles(Brep=loft)
B_2 = ClusterInput()
deplane = DeconstructPlane(Plane=planar.Plane)  # -> Origin, XAxis, YAxis, ZAxis
deplane_2 = DeconstructPlane(Plane=planar_2.Plane)  # -> Origin, XAxis, YAxis, ZAxis
planar_3 = Planar(Curve=item_6)  # -> Planar, Plane, Deviation
planar_4 = Planar(Curve=item)  # -> Planar, Plane, Deviation
planar_5 = Planar(Curve=item_4)  # -> Planar, Plane, Deviation
pcen = PolygonCenter(Polyline=item_5)  # -> CenterV, CenterE, CenterA
pcen_2 = PolygonCenter(Polyline=item_2)  # -> CenterV, CenterE, CenterA
planar_6 = Planar(Curve=item_3)  # -> Planar, Plane, Deviation
deplane_3 = DeconstructPlane(Plane=planar_3.Plane)  # -> Origin, XAxis, YAxis, ZAxis
deplane_4 = DeconstructPlane(Plane=planar_4.Plane)  # -> Origin, XAxis, YAxis, ZAxis
geo = Geometry(pcen.CenterA)
multiplication = Multiplication(A=deplane_2.ZAxis, B=B_2)
pcen_3 = PolygonCenter(Polyline=item_6)  # -> CenterV, CenterE, CenterA
deplane_5 = DeconstructPlane(Plane=planar_5.Plane)  # -> Origin, XAxis, YAxis, ZAxis
multiplication_2 = Multiplication(A=deplane.ZAxis, B=B_2)
geo_2 = Geometry(pcen_2.CenterA)
pcen_4 = PolygonCenter(Polyline=item)  # -> CenterV, CenterE, CenterA
deplane_6 = DeconstructPlane(Plane=planar_6.Plane)  # -> Origin, XAxis, YAxis, ZAxis
pcen_5 = PolygonCenter(Polyline=item_4)  # -> CenterV, CenterE, CenterA
multiplication_3 = Multiplication(A=deplane_3.ZAxis, B=B_2)
move = Move(Geometry=geo, Motion=multiplication)  # -> Geometry, Transform
pcen_6 = PolygonCenter(Polyline=item_3)  # -> CenterV, CenterE, CenterA
geo_3 = Geometry(pcen_3.CenterA)
multiplication_4 = Multiplication(A=deplane_4.ZAxis, B=B_2)
move_2 = Move(Geometry=geo_2, Motion=multiplication_2)  # -> Geometry, Transform
geo_4 = Geometry(pcen_4.CenterA)
multiplication_5 = Multiplication(A=deplane_5.ZAxis, B=B_2)
geo_5 = Geometry(pcen_5.CenterA)
multiplication_6 = Multiplication(A=deplane_6.ZAxis, B=B_2)
neg = Negative(Value=multiplication_3)
extr = ExtrudePoint(Base=item_5, Point=move.Geometry)
geo_6 = Geometry(pcen_6.CenterA)
extr_2 = ExtrudePoint(Base=item_2, Point=move_2.Geometry)
move_3 = Move(Geometry=geo_3, Motion=neg)  # -> Geometry, Transform
move_4 = Move(Geometry=geo_4, Motion=multiplication_4)  # -> Geometry, Transform
neg_2 = Negative(Value=multiplication_5)
cap_4 = CapHoles(Brep=extr)
cap_5 = CapHoles(Brep=extr_2)
sunion = SolidUnion(Breps=[cap_3, cap_5])
sdiff = SolidDifference(BrepsA=sunion, BrepsB=cap_4)
move_5 = Move(Geometry=geo_5, Motion=neg_2)  # -> Geometry, Transform
move_6 = Move(Geometry=geo_6, Motion=multiplication_6)  # -> Geometry, Transform
extr_3 = ExtrudePoint(Base=item_6, Point=move_3.Geometry)
extr_4 = ExtrudePoint(Base=item, Point=move_4.Geometry)
R = ClusterOutput(sdiff)
extr_5 = ExtrudePoint(Base=item_4, Point=move_5.Geometry)
extr_6 = ExtrudePoint(Base=item_3, Point=move_6.Geometry)
cap_6 = CapHoles(Brep=extr_3)
cap_7 = CapHoles(Brep=extr_4)
cap_8 = CapHoles(Brep=extr_5)
cap_9 = CapHoles(Brep=extr_6)
sdiff_2 = SolidDifference(BrepsA=cap, BrepsB=[cap_6, cap_7])
R_2 = ClusterOutput(sdiff_2)
sunion_2 = SolidUnion(Breps=[cap_7, cap_8, cap_9, cap_2])
R_3 = ClusterOutput(sunion_2)

# ==== cluster Offset
T = ClusterInput()
P = ClusterInput()
branch = TreeBranch(Tree=T, Path=P, MaintainPaths=True)
N = ClusterInput()
item = ListItem(List=branch, Index=0, Wrap=True)
division = Division(A=N, B=2)
Z = UnitZ(Factor=Slider(0.1, range=0..1))
series = Series(Start=division, Step=N, Count=Slider(60, range=0..100))
boundary = BoundarySurfaces(Edges=branch)
brep = Brep(boundary)
extr = Extrude(Base=brep, Direction=Z)
polyoffset = PolylineOffset(
    Polylines=branch,
    Distance=series,
    Plane=Plane(origin=(0, 0, 0), x=(0, 0, 0), y=(0, 0, 0)),
    Tolerance=0.01,
    ClosedFillet=1,
    OpenFillet=1,
    Miter=2)  # -> Contour, Holes
cap = CapHoles(Brep=extr)
geo = Geometry([polyoffset.Contour, polyoffset.Holes])
trim = TrimTree(Tree=geo, Depth=1)
psrfclsd = IsPolysurfaceClosed(Polysurface=boundary)  # -> flatten(Closed)
midpt = CurveMiddle(Curve=trim)
brepsinc = PointInBreps(Brep=cap, Point=midpt, Strict=False)  # -> Inside, Index
multiplication = Multiplication(A=N, B=4)
cull = CullPattern(List=trim, CullPattern=brepsinc.Inside)
py3 = Python3Script(curves=cull, boundary_curve=item, filament_width=N)  # -> lines; inputs curves: list of Curve, boundary_curve: Curve
# ---------- py3: Python ----------
import Rhino
from Rhino.Geometry import Curve, Point3d, Polyline, Line

points = []
lines = []
d_min = 1000


previous_curve = boundary_curve
ordered_curves = []

while curves: 
    distances = []
    
    ordered_curves.append(previous_curve)

    for curve in curves:
        # Go through the list of offset curves and find the closest to the previous curve
        p1 = previous_curve.PointAtStart
        p2 = curve.PointAt(curve.ClosestPoint(previous_curve.PointAtStart)[1])

        d = p1.DistanceTo(p2)
        
        distance = (curve, d)
        distances.append(distance)

    sorted_list = sorted(distances, key=lambda x: x[1])
    
    new_curve = sorted_list[0][0]

    p = new_curve.ClosestPoint(previous_curve.PointAtStart)[1]
    new_curve.ChangeClosedCurveSeam(p)  # Adjust the seam 
    previous_curve = new_curve

    # Divide the closest curve into points and add them to the list of points 
    point_parameters = previous_curve.DivideByLength(filament_width, True)
                    
    if point_parameters:
        for i in point_parameters:
            points.append(previous_curve.PointAt(i))
        points.pop()  # Remove last point to avoid overlap

    curves.remove(previous_curve)

# Take the list of points and create continuous polyline(s)
for i,point in enumerate(points[:-1]):
    line = Line(points[i],points[i+1])
    if line.Length < 2*filament_width:
        lines.append(line)
# ---------- end py3 ----------
geo_2 = Geometry(py3)
trim_2 = TrimTree(Tree=geo_2, Depth=1)
join = JoinCurves(Curves=trim_2, Preserve=False)
len = Length(Curve=join)
larger = LargerThan(FirstNumber=len, SecondNumber=multiplication)  # -> LargerThan, OrEqualTo
cull_2 = CullPattern(List=join, CullPattern=larger.OrEqualTo)
L = ClusterOutput(cull_2)

# ==== cluster Cluster_5
C = ClusterInput()
bbox = BoundingBox(Content=C, Plane=PlaneXY(0, 0, 0))  # -> Box, Box_2
boxprop = BoxProperties(Box=bbox.Box)  # -> Center, Diagonal, Area, Volume, Degeneracy
devec = DeconstructVector(Vector=boxprop.Diagonal)  # -> XComponent, YComponent, ZComponent
B = ClusterInput()
division = Division(A=devec.ZComponent, B=B)
round = Round(Number=division)  # -> Nearest, Floor, Ceiling
series = Series(Start=0, Step=1, Count=round.Nearest)
layer_number = ClusterInput()  # Layer number
component = ClusterInput()  # Component
component_2 = StreamFilter(Gate=component, Stream0=layer_number, Stream1=series)
s_0 = ClusterOutput(component_2)
